# Grasshopper definition Slime_.gh (Grasshopper 0.9.76)

timer = Timer(TimerInterval=1, Target=c_script)  # disabled
c_script = CSharpScript(reset=Button())  # -> out, A; inputs reset: Boolean
# ---------- c_script: C# ----------
    if(reset || GOAL == null){

      PointArray = new int[size, size];
      GOAL = new int[8];
      c = 0;

      for(i = 0; i <= size - 1; i++){
        for(j = 0; j <= size - 1; j++){
          if(i == 0 || i == 1 || i == size - 2 || i == size - 1 || j == 0 || j == 1 || j == size - 2 || j == size - 1) PointArray[i, j] = 1;
          else PointArray[i, j] = 0;
        }
      }

      Q = 1;

      while(Q <= 5){
        i = random.Next(5, 195) * 2;
        j = random.Next(5, 195) * 2;
        if (PointArray[i, j] == 0) PointArray[i, j] = 1000 + (Q * 100);
        Q += 1;
      }
    }

    step();
    A = display();
# ---------- c_script: C# additional code ----------
  Random random = new Random();

  int size = 400;
  int[,] PointArray;
  int[] GOAL;
  int i = 0; int j = 0; int Q = 0; int HP = 0; int T = 0;
  int GX = 0; int GY = 0; int W = 0; int Wmax = 100000;
  int c = 0;


  public void step(){

    W = 0;
    while (W < Wmax){


      i = random.Next(1, 199) * 2;
      j = random.Next(1, 199) * 2;

      if (PointArray[i, j] >= 100 && PointArray[i, j] < 1000){
        Q = (int) (PointArray[i, j] / 100);
        HP = PointArray[i, j] - (Q * 100);

        if(HP < 30){
          T = random.Next(1, 5);
          if (T == 1 && PointArray[i + 2, j] == 0) {PointArray[i + 2, j] = Q * 100; PointArray[i + 1, j] = Q * 100;}
          if (T == 2 && PointArray[i, j + 2] == 0) {PointArray[i, j + 2] = Q * 100; PointArray[i, j + 1] = Q * 100;}
          if (T == 3 && PointArray[i - 2, j] == 0) {PointArray[i - 2, j] = Q * 100; PointArray[i - 1, j] = Q * 100;}
          if (T == 4 && PointArray[i, j - 2] == 0) {PointArray[i, j - 2] = Q * 100; PointArray[i, j - 1] = Q * 100;}
          if (T == 1 && PointArray[i + 2, j] == 2000 + (100 * Q)) {PointArray[i + 1, j] = Q * 100; GOAL[Q] = 1;}
          if (T == 2 && PointArray[i, j + 2] == 2000 + (100 * Q)) {PointArray[i, j + 1] = Q * 100; GOAL[Q] = 1;}
          if (T == 3 && PointArray[i - 2, j] == 2000 + (100 * Q)) {PointArray[i - 1, j] = Q * 100; GOAL[Q] = 1;}
          if (T == 4 && PointArray[i, j - 2] == 2000 + (100 * Q)) {PointArray[i, j - 1] = Q * 100; GOAL[Q] = 1;}
          PointArray[i, j] += 1;
        } else {
          T = 0;
          if (PointArray[i + 1, j] > 1) T++;
          if (PointArray[i, j + 1] > 1) T++;
          if (PointArray[i - 1, j] > 1) T++;
          if (PointArray[i, j - 1] > 1) T++;
          if ( T <= 1 ) { PointArray[i, j] = 9100; PointArray[i + 1, j] = 0; PointArray[i, j + 1] = 0; PointArray[i - 1, j] = 0; PointArray[i, j - 1] = 0; }
        }
      }

      if( PointArray[i, j] >= 1000 && PointArray[i, j] < 2000){
        Q = (int) (PointArray[i, j] / 100) - 10;
        if (GOAL[Q] == 0 && PointArray[i + 2, j] == 0) {PointArray[i + 2, j] = Q * 100; PointArray[i + 1, j] = Q * 100;}
        if (GOAL[Q] == 0 && PointArray[i, j + 2] == 0) {PointArray[i, j + 2] = Q * 100; PointArray[i, j + 1] = Q * 100;}
        if (GOAL[Q] == 0 && PointArray[i - 2, j] == 0) {PointArray[i - 2, j] = Q * 100; PointArray[i - 1, j] = Q * 100;}
        if (GOAL[Q] == 0 && PointArray[i, j - 2] == 0) {PointArray[i, j - 2] = Q * 100; PointArray[i, j - 1] = Q * 100;}
      }

      if(PointArray[i, j] >= 9000){
        PointArray[i, j]--;
        if(PointArray[i, j] < 9000) PointArray[i, j] = 0;
      }


      W++;
    }


  }

  public List<Object> display(){

    List<Object> display_ = new List<Object>();

    for(i = 0; i <= size - 1; i += 4){
      for(j = 0; j <= size - 1; j += 4){
        GX = i * 3 / 2 + 50;
        GY = j * 3 / 2 + 50;

        if (PointArray[i, j] >= 100 && PointArray[i, j] < 2000){
          Q = (int) (PointArray[i, j] / 100);
          HP = PointArray[i, j] - (Q * 100);
          display_.Add(new Point3d(GX, GY, c * 2));
          // if(Q == 1)display1.Add(new Point3d(GX, GY, c * 2)); //Q1 one group, Q2 second ... until Q7
        }


      }
    }

    return display_;
  }
# ---------- end c_script ----------
